# Grasshopper definition Debugging and testing.gh (Grasshopper 1.0.7)
# Copyright: 2021
# plug-ins: Formicae

# Template Headers
brep = Brep(<brep referenced from the Rhino model>)
c_script = CSharpScript(x=brep)  # -> out, A, B; inputs x: Brep; disabled
# ---------- c_script: C# usings ----------
using System;
using System.Collections.Generic;
using System.Linq;
using System.Text;
using System.Threading.Tasks;
using Rhino.Geometry;
using Grasshopper;
using Grasshopper.Kernel;
using Grasshopper.Kernel.Types;
using GH_IO.Serialization;
using Rhino;
using System.Runtime.InteropServices.WindowsRuntime;
# ---------- c_script: C# ----------
    A = GetGridMesh(GetGridPlane(x), 200);
    B = GetMeshFromPlane(GetGridPlane(x), 1);
# ---------- c_script: C# additional code ----------
  public Plane  GetGridPlane(Brep brep)
  {
    var Brepvertices = brep.Vertices;
    var BrepPts = Brepvertices.Select(a => a.Location).ToList();
    var  LowestX = Brepvertices.Select(a => a.Location).Select(b => b.X).Min();
    var LowestY = Brepvertices.Select(a => a.Location).Select(b => b.Y).Min();
    var LowestZ = Brepvertices.Select(a => a.Location).Select(b => b.Z).Min();
    var MaxX = Brepvertices.Select(a => a.Location).Select(b => b.X).Max();
    var MaxY = Brepvertices.Select(a => a.Location).Select(b => b.Y).Max();

    Point3d Pa = new Point3d();
    Point3d Pb = new Point3d();
    Point3d Pc = new Point3d();

    foreach ( var pt in BrepPts)
    {
      if (pt.X == LowestX && pt.Y == LowestY && pt.Z == LowestZ)
      {
        Pa = pt;
      }
      if (pt.X == MaxX && pt.Y == LowestY && pt.Z == LowestZ)
      {
        Pb = pt;
      }
      if (pt.X == LowestX && pt.Y == MaxY && pt.Z == LowestZ)
      {
        Pc = pt;
      }
    }

    Vector3d u = Pb - Pa;
    u.Unitize();
    Vector3d v = Pc - Pa;
    v.Unitize();
    Point3d origin = Pa;

    Plane plane = new Plane(origin, u, v);
    return plane;
  }

  /// <summary>
  /// Creates a single face with squared offset
  /// </summary>
  /// <param name="plane"></param>
  /// <param name="offset"></param>
  /// <returns></returns>
  public Mesh GetMeshFromPlane(Plane plane, double offset)
  {
    Mesh m = new Mesh();
    m.Vertices.Add(plane.Origin);
    m.Vertices.Add(plane.Origin + plane.YAxis * offset);
    m.Vertices.Add(plane.Origin + plane.YAxis * offset + plane.XAxis * offset);
    m.Vertices.Add(plane.Origin + plane.XAxis * offset);
    m.Faces.AddFace(0, 1, 2, 3);
    return m;
  }

  /// <summary>
  ///
  /// </summary>
  /// <param name="originPlane"></param>
  /// <param name="gridTotalDistance"></param>
  public Mesh GetGridMesh(Plane originPlane, double gridTotalDistance)
  {
    Mesh resultGrid = new Mesh();
    for (int i = 0; i < gridTotalDistance; i++)
    {
      //Create plane in x direction
      Plane offsetedPlane = originPlane;
      offsetedPlane.Translate(originPlane.XAxis * i);
      Mesh OffsetMeshinX = GetMeshFromPlane(offsetedPlane, 1);

      for (int j = 0; j < gridTotalDistance; j++)
      {
        //Translate in y direction
        Mesh tempMesh = OffsetMeshinX.DuplicateMesh();
        tempMesh.Translate(originPlane.YAxis * j);
        resultGrid.Append(tempMesh);
      }
    }
    return resultGrid;
  }
# ---------- end c_script ----------
c_script_2 = CSharpScript(x=brep)  # -> out, A, B; inputs x: Brep; disabled
# ---------- c_script_2: C# usings ----------
using System.Linq;
using Rhino.Geometry.Collections;
# ---------- c_script_2: C# ----------
    //A = GetPa(x);
    // B = GetGridMesh(GetGrid(GetGridPlane(x)));
    A = GetOriginGrid(GetGridPlane(x));
    A = ArrayInY(GetGridPlane(x));
# ---------- c_script_2: C# additional code ----------
  public Plane GetGridPlane(Brep brep)
  {
    var Brepvertices = brep.Vertices;
    var BrepPts = Brepvertices.Select(a => a.Location).ToList();
    var  LowestX = Brepvertices.Select(a => a.Location).Select(b => b.X).Min();
    var LowestY = Brepvertices.Select(a => a.Location).Select(b => b.Y).Min();
    var LowestZ = Brepvertices.Select(a => a.Location).Select(b => b.Z).Min();
    var MaxX = Brepvertices.Select(a => a.Location).Select(b => b.X).Max();
    var MaxY = Brepvertices.Select(a => a.Location).Select(b => b.Y).Max();

    Point3d Pa = new Point3d();
    Point3d Pb = new Point3d();
    Point3d Pc = new Point3d();

    foreach ( var pt in BrepPts)
    {
      if (pt.X == LowestX && pt.Y == LowestY && pt.Z == LowestZ)
      {
        Pa = pt;
      }
      if (pt.X == MaxX && pt.Y == LowestY && pt.Z == LowestZ)
      {
        Pb = pt;
      }
      if (pt.X == LowestX && pt.Y == MaxY && pt.Z == LowestZ)
      {
        Pc = pt;
      }
    }

    Vector3d u = Pb - Pa;
    Vector3d v = Pc - Pa;
    Point3d origin = Pa;

    Plane plane = new Plane(origin, u, v);
    return plane;
  }

  public Point3d GetPa(Brep brep)
  {
    var Brepvertices = brep.Vertices;
    var BrepPts = Brepvertices.Select(a => a.Location).ToList();
    var  LowestX = (int) Brepvertices.Select(a => a.Location).Select(b => b.X).Min();
    var LowestY = (int) Brepvertices.Select(a => a.Location).Select(b => b.Y).Min();
    var LowestZ = (int) Brepvertices.Select(a => a.Location).Select(b => b.Z).Min();
    var MaxX = (int) Brepvertices.Select(a => a.Location).Select(b => b.X).Max();
    var MaxY = (int) Brepvertices.Select(a => a.Location).Select(b => b.Y).Max();

    Point3d Pa = new Point3d();
    Point3d Pb = new Point3d();
    Point3d Pc = new Point3d();

    foreach ( var pt in BrepPts)
    {
      if (pt.X == LowestX && pt.Y == LowestY && pt.Z == LowestZ)
      {
        Pa = pt;
      }
      if (pt.X == MaxX && pt.Y == LowestY && pt.Z == LowestZ)
      {
        Pb = pt;
      }
      if (pt.X == LowestX && pt.Y == MaxY && pt.Z == LowestZ)
      {
        Pc = pt;
      }
    }

    Vector3d u = Pb - Pa;
    u.Unitize();
    Vector3d v = Pc - Pa;
    v.Unitize();
    Point3d origin = Pa;

    Plane plane = new Plane(origin, u, v);
    return Pa;
  }

  public List<Point3d> GetGrid ()
  {
    Mesh mesh = new Mesh();
    List<Point3d> pts = new List<Point3d>();
    for(int i = 0; i < 200 ; i++)
    {
      for (int j = 0 ; j < 200 ; j++)
      {
        pts.Add(new Point3d(i, j, 0));
      }
    }

    return pts;
  }

  public List<Point3d> GetGrid (Plane plane)
  {
    Mesh mesh = new Mesh();
    List<Point3d> pts = new List<Point3d>();
    var originPt = plane.Origin;
    for(int i = 0; i < 200 ; i++)
    {
      for (int j = 0 ; j < 200 ; j++)
      {
        pts.Add(new Point3d(i + originPt.X, j + originPt.Y, originPt.Z));
      }
    }
    return pts;
  }

  public Mesh GetOriginGrid (Plane plane)
  {
    Mesh originMesh = new Mesh();
    originMesh.Vertices.Add(new Point3d(plane.Origin));
    originMesh.Vertices.Add(new Point3d(plane.Origin + plane.XAxis * 1));
    originMesh.Vertices.Add(new Point3d(plane.Origin + plane.XAxis * 1 + plane.YAxis * 1));
    originMesh.Vertices.Add(new Point3d(plane.Origin + plane.YAxis * 1));
    originMesh.Faces.AddFace(new MeshFace(0, 1, 2, 3));
    return originMesh;
  }

  public Mesh ArrayInY(Plane plane)
  {
    var mesh = new Mesh();
    var originMesh = GetOriginGrid(plane);
    //mesh(originMesh);
    mesh.Append(originMesh);
    for(int i = 0; i < 200 ; i++ )
    {
      var tempMesh = originMesh.DuplicateMesh();
      tempMesh.Translate(plane.YAxis * i);
      mesh.Append(tempMesh);
    }
    return mesh;
  }


  public Mesh createGridMeshes(Plane plane)
  {
    Mesh resultGrid = new Mesh();

    for(int i = 0; i < 200 ; i++)
    {
      //Create mesh to offset and add it

    }
  }
# ---------- end c_script_2 ----------
create_simulation_box = CreateSimulationBox(Box=brep)  # -> SimulationPoints, ResultMeshGrid, SimulationBox
c_script_3 = CSharpScript(x=brep)  # -> out, A; inputs x: Brep; disabled
# ---------- c_script_3: C# ----------
A  =
# ---------- c_script_3: C# additional code ----------
  /// <summary>
  /// Create a mesh grid (Read vertically)
  /// </summary>
  /// <param name="plane">Top left corner</param>
  /// <returns></returns>
  public Mesh GetPlaneForMeshSimulation(Plane plane)
  {            // 1 meter
    double offset = 1;
    Mesh m = new Mesh();
    m.Vertices.Add(plane.Origin);
    m.Vertices.Add(plane.Origin - plane.YAxis * offset);
    m.Vertices.Add(plane.Origin - (plane.YAxis * offset) + (plane.XAxis * offset));
    m.Vertices.Add(plane.Origin + plane.XAxis * offset);
    m.Faces.AddFace(0, 1, 2, 3);
    return m;
  }

  public Mesh GetGridMeshForSimulation(Plane OriginPlane, double GridtTotalDistance)
  {
    Mesh resultGrid = new Mesh();

    for (int i = 0; i < GridtTotalDistance; i++)
    {
      //Create plane in Y direction
      Plane offsetedPlane = OriginPlane;
      offsetedPlane.Translate(OriginPlane.XAxis * i);
      Mesh OffsetMeshinY = GetPlaneForMeshSimulation(offsetedPlane);

      for (int j = 0; j < GridtTotalDistance; j++)
      {
        //Translate in X direction
        Mesh tempMesh = OffsetMeshinY.DuplicateMesh();
        tempMesh.Translate(OriginPlane.XAxis * j);
        resultGrid.Append(tempMesh);
      }
    }
    return resultGrid;
  }
# ---------- end c_script_3 ----------
geometry = Geometry(c_script.A)  # disabled
mesh = Mesh(<mesh referenced from the Rhino model>)
brep_2 = Brep([<brep referenced from the Rhino model> x4])
deconstruct_mesh = DeconstructMesh(Mesh=geometry)  # -> Vertices, Faces, Colours, Normals; disabled
mesh_2 = Mesh(<mesh referenced from the Rhino model>)  # disabled
list_item = ListItem(List=create_simulation_box.SimulationPoints, Index=0, Wrap=True)  # disabled
mesh_3 = Mesh(<mesh referenced from the Rhino model>)  # disabled
gh_createwindsimulationmodel = GH_CreateWindSimulationModel(TerrainMesh=mesh, BuildingsBreps=brep_2, SimulationBox=create_simulation_box.SimulationBox)
panel = Panel(create_simulation_box.SimulationBox)
c_script_4 = CSharpScript(ToDrape=mesh_3, Target=mesh_2)  # -> out, A; inputs ToDrape: Mesh, Target: Mesh; disabled
# ---------- c_script_4: C# usings ----------
using Rhino.Geometry.Intersect;
using System.Linq;
# ---------- c_script_4: C# ----------
    A = DrapeMesh(ToDrape, Target);
# ---------- c_script_4: C# additional code ----------
  public  List<Point3d> ProjectPointsDownardOnMesh(IEnumerable<Point3d> pts, Mesh mesh)
  {
    Mesh[] meshArray = new Mesh[1];
    meshArray[0] = mesh;
    var projectedPts = Intersection.ProjectPointsToMeshes(meshArray, pts, Vector3d.ZAxis * -1, RhinoDoc.ActiveDoc.ModelAbsoluteTolerance).ToList();
    return projectedPts;
  }

  /// <summary>
  ///
  /// </summary>
  /// <param name="MeshToDrape"></param>
  /// <param name="TargetMesh"></param>
  /// <returns></returns>
  public  Mesh DrapeMesh(Mesh MeshToDrape, Mesh TargetMesh)
  {
    var pointsToProject = MeshToDrape.Vertices.ToPoint3dArray();
    var projectdPts = ProjectPointsDownardOnMesh(pointsToProject, TargetMesh);
    Mesh drappedMesh = new Mesh();
    drappedMesh.Vertices.AddVertices(projectdPts);
    drappedMesh.Faces.AddFaces(MeshToDrape.Faces);
    return drappedMesh;
  }
# ---------- end c_script_4 ----------

# ---- group: Model With Bldgs
ghpython_script = GhPythonScript(x=gh_createwindsimulationmodel)  # -> out, a; disabled
# ---------- ghpython_script: Python ----------
__author__ = "mm1039"
__version__ = "2024.02.14"

import rhinoscriptsyntax as rs

a = x.ModelWithBuildings
# ---------- end ghpython_script ----------

# ---- group: ModelWithoutBuilding
ghpython_script_2 = GhPythonScript(x=gh_createwindsimulationmodel)  # -> out, a; disabled
# ---------- ghpython_script_2: Python ----------
__author__ = "mm1039"
__version__ = "2024.02.14"

import rhinoscriptsyntax as rs

a = x.ModelwithoutBuildings
# ---------- end ghpython_script_2 ----------

# ---- group: Result mesh draped
ghpython_script_3 = GhPythonScript(x=gh_createwindsimulationmodel)  # -> out, a; disabled
# ---------- ghpython_script_3: Python ----------
__author__ = "mm1039"
__version__ = "2024.02.14"

import rhinoscriptsyntax as rs

a = x.GetResultMeshDraped()
# ---------- end ghpython_script_3 ----------

# ----
gh_createheightmaps = GH_CreateHeightMaps(WindSimModel=gh_createwindsimulationmodel)  # -> HeightsMapWithoutBuildings, HeightsMapWithBuildings
bounds = Bounds()
