# Grasshopper definition Testgenerator_Terrain_Buildings.gh (Grasshopper 1.0.7)

y_length = Slider(157, range=2..200)
x_length = Slider(151, range=2..200)
buildings_number = Slider(6, range=1..20)
mesh_density = Slider(152, range=2..200)
height_factor = Slider(72, range=2..200)
division = Division(A=y_length, B="-2")
division_2 = Division(A=y_length, B="2")
division_3 = Division(A=x_length, B="-2")
division_4 = Division(A=x_length, B="2")
dom = ConstructDomain(DomainStart=division_3, DomainEnd=division_4)
dom_2 = ConstructDomain(DomainStart=division, DomainEnd=division_2)
rectangle = Rectangle(Plane=PlaneXY(0, 0, 0), XSize=dom, YSize=dom_2, Radius=0)  # -> Rectangle, Length
mplane = MeshPlane(Boundary=rectangle.Rectangle, WidthCount=mesh_density, HeightCount=mesh_density)  # -> Mesh, Area
demesh = DeconstructMesh(Mesh=mplane.Mesh)  # -> Vertices, Faces, Colours, Normals
random = Random(Range=Domain(0, 100), Number=buildings_number, Seed=Slider(2, range=0..10))
random_2 = Random(Range=Domain(0, 100), Number=buildings_number, Seed=Slider(6, range=0..10))
x_min = Slider(10, range=5..100)
x_max = Slider(40, range=10..100)
y_min = Slider(18, range=5..100)
y_max = Slider(25, range=10..100)
number_slider = Slider(4, range=0..10)
height_min = Slider(10, range=10..100)
height_max = Slider(54, range=10..100)
rotation_max = Slider(180, range=0..180)
pdecon = Deconstruct(Point=demesh.Vertices)  # -> XComponent, YComponent, ZComponent
bnd = Bounds(Numbers=pdecon.YComponent)
bnd_2 = Bounds(Numbers=pdecon.XComponent)
dom_3 = ConstructDomain(DomainStart=0, DomainEnd=1)
dom_4 = ConstructDomain(DomainStart=y_min, DomainEnd=y_max)
dom_5 = ConstructDomain(DomainStart=height_min, DomainEnd=height_max)
dom_6 = ConstructDomain(DomainStart=x_min, DomainEnd=x_max)
remap = RemapNumbers(Value=pdecon.YComponent, Source=bnd, Target=dom_3)  # -> Mapped, Clipped
remap_2 = RemapNumbers(Value=pdecon.XComponent, Source=bnd_2, Target=dom_3)  # -> Mapped, Clipped
random_3 = Random(Range=Domain(0, 1), Number=buildings_number, Seed=Slider(7, range=0..10))
graph = GraphMapper(
    remap_2.Mapped,
    x0=0,
    x1=1,
    y0=0,
    y1=1,
    container_name="Bezier",
    cpx=[0, 0.5167882442, 0.6023190022, 1],
    cpy=[0.7109978795, 0, 0.9497018456, 0.4859338403])
graph_2 = GraphMapper(
    remap.Mapped,
    x0=0,
    x1=1,
    y0=0,
    y1=1,
    container_name="Bezier",
    cpx=[0, 0.5600774884, 0.4538409412, 1],
    cpy=[0.6980143785, 0.2707970738, 0.8559256196, 0.5992685556])
random_4 = Random(Range=dom_6, Number=buildings_number, Seed=Slider(4, range=0..10))
random_5 = Random(Range=dom_4, Number=buildings_number, Seed=Slider(8, range=0..10))
graph_3 = GraphMapper(
    random_3,
    x0=0,
    x1=1,
    y0=0,
    y1=1,
    container_name="Bezier",
    cpx=[0, 0.2756906748, 1, 1],
    cpy=[0, 0.6117969751, 0, 0.873927474])
random_6 = Random(Range=dom_5, Number=buildings_number, Seed=Slider(4, range=0..10))
multiplication = Multiplication(A=graph, B=graph_2)
multiplication_2 = Multiplication(A=multiplication, B=height_factor)
multiplication_3 = Multiplication(A=graph_3, B=rotation_max)
pt = ConstructPoint(XCoordinate=pdecon.XComponent, YCoordinate=pdecon.YComponent, ZCoordinate=multiplication_2)
rad = Radians(Degrees=multiplication_3)
Z = UnitZ(Factor=1)
Z_2 = UnitZ(Factor=random_6)
conmesh = ConstructMesh(Vertices=pt, Faces=demesh.Faces)
mesh = Mesh(conmesh)
mesh_2 = Mesh(mesh)
demesh_2 = DeconstructMesh(Mesh=mesh_2)  # -> Vertices, Faces, Colours, Normals
pdecon_2 = Deconstruct(Point=demesh_2.Vertices)  # -> XComponent, YComponent, ZComponent
bnd_3 = Bounds(Numbers=pdecon_2.YComponent)
bnd_4 = Bounds(Numbers=pdecon_2.XComponent)
dedomain = DeconstructDomain(Domain=bnd_3)  # -> Start, End
dedomain_2 = DeconstructDomain(Domain=bnd_4)  # -> Start, End
subtraction = Subtraction(A=dedomain_2.End, B=random_4)
addition = Addition(A=dedomain_2.Start, B=random_4)
addition_2 = Addition(A=dedomain.Start, B=random_5)
subtraction_2 = Subtraction(A=dedomain.End, B=random_5)
dom_7 = ConstructDomain(DomainStart=addition, DomainEnd=subtraction)
dom_8 = ConstructDomain(DomainStart=addition_2, DomainEnd=subtraction_2)
random_7 = Random(Range=dom_7, Number=1, Seed=random)  # -> flatten(Random)
random_8 = Random(Range=dom_8, Number=1, Seed=random_2)  # -> flatten(Random)
pt_2 = ConstructPoint(XCoordinate=random_7, YCoordinate=random_8, ZCoordinate=0)
xy = XYPlane(Origin=pt_2)
rectangle_2 = Rectangle(Plane=pt_2, XSize=random_4, YSize=random_5, Radius=0)  # -> Rectangle, Length
rotate = Rotate(Geometry=rectangle_2.Rectangle, Angle=rad, Plane=xy)  # -> Geometry, Transform
mesh_3 = Mesh(mesh_2)
cpoly = ControlPolygon(Curve=rotate.Geometry)  # -> Polygon, Points
boundary = BoundarySurfaces(Edges=rotate.Geometry)
meshray = MeshRay(Mesh=mesh_3, Point=cpoly.Points, Direction=Z)  # -> Point, Hit
extr = Extrude(Base=boundary, Direction=Z_2)
pdecon_3 = Deconstruct(Point=meshray.Point)  # -> XComponent, YComponent, ZComponent
bnd_5 = Bounds(Numbers=pdecon_3.ZComponent)
dedomain_3 = DeconstructDomain(Domain=bnd_5)  # -> flatten(Start), End
Z_3 = UnitZ(Factor=dedomain_3.Start)
move = Move(Geometry=extr, Motion=Z_3)  # -> Geometry, Transform
geo = Geometry(move.Geometry)
