# Grasshopper definition Windrose_Forma_clustered.gh (Grasshopper 1.0.7)

path = FilePath("C:\Users\PZI\Downloads\input.json")
windrose_radius = Slider(12.1, range=5..20)
windrose_color = ColourSwatch(SwatchColor=RGB(130, 130, 130))
radius_inner_circle = Slider(3, range=0..5)
directions_offset = Slider(2.1, range=0..5)
directions_text_height = Slider(7, range=0..10)
directions_text_color = ColourSwatch(SwatchColor=RGB(0, 0, 0))
probability_text_height = Slider(2.2, range=0..10)
probability_text_color = ColourSwatch(SwatchColor=RGB(43, 43, 43))
cluster = Cluster(
    json_file_from_forma=path,
    windrose_radius=windrose_radius,
    windrose_color=windrose_color,
    radius_inner_circle=radius_inner_circle,
    directions_offset=directions_offset,
    directions_text_height=directions_text_height,
    directions_text_color=directions_text_color,
    probability_text_height=probability_text_height,
    probability_text_color=probability_text_color)  # -> probability_direction_2, probability_percent_2
probability_direction = Number(cluster.probability_direction_2)
probability_percent = Number(cluster.probability_percent_2)

# ==== cluster Cluster
json_file_from_forma = ClusterInput()
windrose_radius = ClusterInput()
windrose_color = ClusterInput()
radius_inner_circle = ClusterInput()
probability_text_height = ClusterInput()
directions_offset = ClusterInput()
directions_text_height = ClusterInput()
directions_text_color = ClusterInput()
probability_text_color = ClusterInput()
json_file_from_forma_2 = FilePath(json_file_from_forma)
windrose_radius_2 = Number(windrose_radius)
windrose_color_2 = Colour(windrose_color)
radius_inner_circle_2 = Number(radius_inner_circle)
directions_offset_2 = Number(directions_offset)
directions_text_color_2 = Colour(directions_text_color)
probability_text_height_2 = Number(probability_text_height)
probability_text_color_2 = Colour(probability_text_color)
directions_text_height_2 = Number(directions_text_height)
num = Number(windrose_radius_2)
num_2 = Number(radius_inner_circle_2)
python = GhPythonScript(path=json_file_from_forma_2, radius=windrose_radius_2)  # -> out, d_list, p_list, f_list
# ---------- python: Python ----------
__author__ = "philipp zimmermann"
__version__ = "2024.02.13"

import rhinoscriptsyntax as rs
import Rhino as R
import json
 
f = open(path)
 
# returns JSON object as 
# a dictionary
data = json.load(f)
 
test=[]
direction_list, probability_list,probability_list_percentage = [],[],[]
for item in data["windRose"]["data"]:
    direction = item["direction"]
    probability = item["probability"]
    weibull_scale_parameter = item["weibull_scale_parameter"]
    weibull_shape_parameter = item["weibull_shape_parameter"]
    test.append([direction,probability,weibull_scale_parameter,weibull_shape_parameter])
    direction_list.append(direction)
    probability_list.append(probability)
    probability_list_percentage.append(str(int(round(probability,2)*100))+"%")

# Closing file
f.close()

d_list = direction_list
p_list = probability_list
f_list = probability_list_percentage
# ---------- end python ----------
addition = Addition(A=num, B="150")
multiplication = Multiplication(A=addition, B="-1")
txt = Text(python.f_list)
num_3 = Number(python.p_list)
pt = ConstructPoint(XCoordinate=addition, YCoordinate=multiplication, ZCoordinate=0)
pt_2 = Point(pt)
cir = Circle(Plane=pt_2, Radius=num)
cir_2 = Circle(Plane=pt_2, Radius=num_2)
rad = Radians(Degrees="112.5")
flip = FlipCurve(Curve=cir_2)  # -> Curve, Flag
flip_2 = FlipCurve(Curve=cir)  # -> Curve, Flag

# ---- group: remap values to radius
bnd = Bounds(Numbers=num_3)
subtraction = Subtraction(A=num, B=num_2)
dedomain = DeconstructDomain(Domain=bnd)  # -> Start, End
dom = ConstructDomain(DomainStart="0", DomainEnd=subtraction)
dom_2 = ConstructDomain(DomainStart=0, DomainEnd=dedomain.End)
remap = RemapNumbers(Value=num_3, Source=dom_2, Target=dom)  # -> Mapped, Clipped

# ----
rotate = Rotate(Geometry=flip.Curve, Angle=rad, Plane=pt_2)  # -> Geometry, Transform
rotate_2 = Rotate(Geometry=flip_2.Curve, Angle=rad, Plane=pt_2)  # -> Geometry, Transform
divide = DivideCurve(Curve=rotate.Geometry, Count="8", Kinks=False)  # -> Points, Tangents, Parameters
divide_2 = DivideCurve(Curve=rotate_2.Geometry, Count="8", Kinks=False)  # -> Points, Tangents, Parameters
num_4 = Number(probability_text_height_2)
shatter = Shatter(Curve=rotate.Geometry, Parameters=divide.Parameters)
shatter_2 = Shatter(Curve=rotate_2.Geometry, Parameters=divide_2.Parameters)
multiplication_2 = Multiplication(A=num_4, B="1.5")
crv = Curve(flatten(shatter))
crv_2 = Curve(flatten(shatter_2))
num_5 = Number([num, directions_offset_2, multiplication_2])
offset = OffsetCurve(Curve=crv, Distance=remap.Mapped, Corners=1)  # -> flatten(Curve)
offset_2 = OffsetCurve(Curve=crv_2, Distance=multiplication_2, Corners=1)  # -> flatten(Curve)
ma = MassAddition(Input=num_5)  # -> Result, PartialResults
end = EndPoints(Curve=crv)  # -> Start, End
end_2 = EndPoints(Curve=crv_2)  # -> Start, End
crv_3 = Curve(flatten(offset))
curvepoint = PointOnCurve(offset_2, parameter=0.5)
addition_2 = Addition(A=ma.Result, B=directions_offset_2)
merge = Merge(Data1=graft(crv_3), Data2=graft(crv))
pt_3 = Point(curvepoint)
num_6 = Number(probability_text_height_2)
num_7 = Number(addition_2)
num_8 = Number(addition)
num_9 = Number(multiplication)
num_10 = Number(probability_text_height_2)
num_11 = Number(directions_text_height_2)
python_2 = GhPythonScript(points_in=pt_3, h=num_6)  # -> out, flatten(points_out)
# ---------- python_2: Python ----------
__author__ = "philipp zimmermann"
__version__ = "2024.02.14"

import rhinoscriptsyntax as rs

points_out=[]
for i in [points_in]:
    point = rs.coerce3dpoint(i)
    points_out.append(rs.CreatePoint(point.X-h, point.Y-h/2))
# ---------- end python_2 ----------
loft = Loft(Curves=merge, Options={Adjust=False, Closed=False, LoftEnds=0, LoftSimp=0, LoftType=0, Rebuild=10, Refit=0.01})  # -> flatten(Loft)
ln = Line(StartPoint=end.End, EndPoint=end_2.End)
python_3 = GhPythonScript(r=num_7, x=num_8, y=num_9, o=num_10, h=num_11)  # -> out, points, directions
# ---------- python_3: Python ----------
__author__ = "philipp zimmermann"
__version__ = "2024.02.14"

import rhinoscriptsyntax as rs

points = []
points.append(rs.CreatePoint(x-h/2, y+r-h/2+o))
points.append(rs.CreatePoint(x+r-h/2+o, y-h/2))
points.append(rs.CreatePoint(x-h/2, y-r-h/2-o))
points.append(rs.CreatePoint(x-r-h-o, y-h/2))

directions = ['N','E','S','W']
# ---------- end python_3 ----------
probability_percent = Number(python.p_list)
col = Colour(probability_text_color_2)
col_2 = Colour(windrose_color_2)
pt_4 = Point(python_2.points_out)
txt_2 = Text(python_3.directions)
probability_direction = Number(python.d_list)
txt_3 = Text(txt)
geo = Geometry([ln, cir, loft])
col_3 = Colour(directions_text_color_2)
pt_5 = Point(python_3.points)
num_12 = Number(num_11)
probability_percent_2 = ClusterOutput(probability_percent)
probability_direction_2 = ClusterOutput(probability_direction)
preview = CustomPreview(Geometry=geo, Material=col_2)
tag = TextTag3D(Location=pt_4, Text=txt_3, Size=num_6, Colour=col, Justification=7)
tag_2 = TextTag3D(Location=pt_5, Text=txt_2, Size=num_12, Colour=col_3, Justification=7)
