# Grasshopper definition forma-api.gh (Grasshopper 1.0.7)
# Copyright: 2020
# plug-ins: Swiftlet, jSwan, ProceduralCS, Formicae, ShapeDiverForGrasshopper

sddp = ShapeDiverDocumentPayload({AbsoluteTolerance=0, AngleTolerance=0, DistanceDisplayPrecision=0, GltfVersion="Gltf2", GrasshopperVersion="1.0.0007", InputGroups="{}", OutputGroups="{}", RelativeTolerance=0, RhinoVersion="7.31.23166.15001", UnitSystem=0, VersionCreated="1.16.0.0", VersionSaved="1.16.0.0"})
panel = Panel("https://app.autodeskforma.eu/designmode/pro_74nzjy4r4h/03ac9e63-182e-41b2-b5af-81e7b3ee2088")
auth = Auth(Trigger=Button())
clean = CleanTree(RemoveNulls=True, RemoveInvalid=True, RemoveEmpty=False, Tree=auth)
data = Data(flatten(clean))
pipeline = GeometryPipeline(
    GroupByLayer=False,
    GroupByType=False,
    IncludeHidden=True,
    IncludeLocked=True,
    LayerFilter="Forma::Terrain",
    NameFilter="*",
    SublayerFiltering=True,
    TypeFilter=32)
pipeline_2 = GeometryPipeline(
    GroupByLayer=False,
    GroupByType=False,
    IncludeHidden=True,
    IncludeLocked=True,
    LayerFilter="Forma::Buildings",
    NameFilter="*",
    SublayerFiltering=True,
    TypeFilter=1073741880)
python = GhPythonScript()  # -> out, key, value
# ---------- python: Python ----------
import rhinoscriptsyntax as rs

ghenv.Component.Message = "x-ads-region"


key = "x-ads-region"
value = "EMEA"
# ---------- end python ----------
python_2 = GhPythonScript(url=panel)  # -> out, key, value
# ---------- python_2: Python ----------
import rhinoscriptsyntax as rs

ghenv.Component.Message = "authcontext"
urlParts = url.split("/")

key = "authcontext"
value = urlParts[-2]
# ---------- end python_2 ----------
bearer = BearerTokenAuth(Token=data)
python_3 = GhPythonScript()  # -> out, endPoint
# ---------- python_3: Python ----------
__author__ = "ARZE"
__version__ = "2024.02.14"

import rhinoscriptsyntax as rs
ghenv.Component.Message = "Wind params end point"
endPoint  = "https://developer.api.autodesk.com/forma/wind-prediction/v1alpha/parameters"
# ---------- end python_3 ----------
ch = CreateHttpHeader(Key=python.key, Value=python.value)
cqp = CreateQueryParam(Key=python_2.key, Value=python_2.value)
mesh = Mesh([pipeline_2, pipeline])
merge = Merge(Data1=bearer, Data2=ch)
mjoin = MeshJoin(Meshes=mesh)
get = GETRequest(URL=python_3.endPoint, Params=cqp, Headers=merge)  # -> Status, Content, Response
fg_ta = GH_terrainArrays(Terrain=pipeline, TerrainBuilding=mjoin)  # -> HeightDictionary, AnalysisMesh
panel_2 = Panel(get.Status)
list = ValueList({"lawson_lddcv": "lawson_lddc", "davenport", "lawson", "lawson_2001", "nen8100", "cstb"}, selected="davenport")
gh_postarray = GH_postArray(HeightArray=fg_ta.HeightDictionary, WindParameters=get.Content, WindcomfortClass=list)
windrose_radius = Slider(12.1, range=5..20)
directions_text_height = Slider(6.6, range=0..10)
probability_text_height = Slider(1.9, range=0..10)
windrose_color = ColourSwatch(SwatchColor=RGB(105, 105, 105))
radius_inner_circle = Slider(3, range=0..5)
directions_offset = Slider(2.1, range=0..5)
directions_text_color = ColourSwatch(SwatchColor=RGB(0, 0, 0))
probability_text_color = ColourSwatch(SwatchColor=RGB(43, 43, 43))
python_4 = GhPythonScript()  # -> out, endPoint
# ---------- python_4: Python ----------
__author__ = "ARZE"
__version__ = "2024.02.14"

import rhinoscriptsyntax as rs
ghenv.Component.Message = "Predict end point"
#endPoint  = "https://developer.api.autodesk.com/forma/wind-prediction/v1alpha/predict"
endPoint = "https://developer.api.autodesk.com/forma/wind-prediction/v1alpha/comfort/predict"
# ---------- end python_4 ----------
ctb = CreateTextBody(
    Content=gh_postarray,
    IsHtmlChecked=False,
    IsJavascriptChecked=False,
    IsJsonChecked=True,
    IsTextChecked=False,
    IsXmlChecked=False)
merge_2 = Merge(Data1=bearer, Data2=ch)
post = POSTRequest(URL=python_4.endPoint, Body=ctb, Params=cqp, Headers=merge_2)  # -> Status, Content, Response
dam = DataDam(DataA=get.Content, BufferDelay=10000000, BufferMode=0)
dejson = DeserializeJson(JSON=post.Content, OutputsLocked=False)  # -> Heatmap_data, Heatmap_mask, Metadata
json_file_from_forma = FilePath(dam)
windrose_radius_2 = Number(windrose_radius)
windrose_color_2 = Colour(windrose_color)
radius_inner_circle_2 = Number(radius_inner_circle)
directions_offset_2 = Number(directions_offset)
directions_text_height_2 = Number(directions_text_height)
directions_text_color_2 = Colour(directions_text_color)
probability_text_height_2 = Number(probability_text_height)
probability_text_color_2 = Colour(probability_text_color)
panel_3 = Panel(dam)
panel_4 = Panel("""178, 248, 218
85, 220, 162
254, 213, 42
254, 168, 0
177, 25, 15""")
num = Number(windrose_radius_2)
num_2 = Number(radius_inner_circle_2)
python_5 = GhPythonScript(windJson=dam, radius=windrose_radius_2)  # -> out, d_list, p_list, f_list
# ---------- python_5: Python ----------
__author__ = "philipp zimmermann"
__version__ = "2024.02.13"

import rhinoscriptsyntax as rs
import Rhino as R
import json

 

# Convert string to JSON object (dictionary)
data = json.loads(windJson)

test = []
direction_list, probability_list, probability_list_percentage = [], [], []
for item in data["data"]:
    direction = item["direction"]
    probability = item["probability"]
    weibull_scale_parameter = item["weibull_scale_parameter"]
    weibull_shape_parameter = item["weibull_shape_parameter"]
    test.append([direction, probability, weibull_scale_parameter, weibull_shape_parameter])
    direction_list.append(direction)
    probability_list.append(probability)
    # Adjust the rounding to 2 decimal places before converting to percentage
    probability_list_percentage.append("{}%".format(round(probability * 100, 2)))

d_list = direction_list
p_list = probability_list
f_list = probability_list_percentage
# ---------- end python_5 ----------
addition = Addition(A=num, B="150")
prob = Data(fg_ta.AnalysisMesh)
multiplication = Multiplication(A=addition, B="-1")
num_3 = Number(python_5.p_list)
txt = Text(python_5.f_list)
pt = ConstructPoint(XCoordinate=addition, YCoordinate=multiplication, ZCoordinate=0)
recolor_mesh = RecolorMesh(
    Mesh=prob,
    Result=dejson.Heatmap_data,
    ListOfColors=panel_4,
    LowerBoundary=0,
    UpperBoundary=Slider(4, range=0..10),
    Segments=10)  # -> ColoredMesh, Colors, Values
pt_2 = Point(pt)
cir = Circle(Plane=pt_2, Radius=num)
cir_2 = Circle(Plane=pt_2, Radius=num_2)
rad = Radians(Degrees="112.5")
flip = FlipCurve(Curve=cir_2)  # -> Curve, Flag
flip_2 = FlipCurve(Curve=cir)  # -> Curve, Flag

# ---- group: remap values to radius
bnd = Bounds(Numbers=num_3)
subtraction = Subtraction(A=num, B=num_2)
dedomain = DeconstructDomain(Domain=bnd)  # -> Start, End
dom = ConstructDomain(DomainStart="0", DomainEnd=subtraction)
dom_2 = ConstructDomain(DomainStart=0, DomainEnd=dedomain.End)
remap = RemapNumbers(Value=num_3, Source=dom_2, Target=dom)  # -> Mapped, Clipped

# ----
rotate = Rotate(Geometry=flip.Curve, Angle=rad, Plane=pt_2)  # -> Geometry, Transform
rotate_2 = Rotate(Geometry=flip_2.Curve, Angle=rad, Plane=pt_2)  # -> Geometry, Transform
divide = DivideCurve(Curve=rotate.Geometry, Count="8", Kinks=False)  # -> Points, Tangents, Parameters
divide_2 = DivideCurve(Curve=rotate_2.Geometry, Count="8", Kinks=False)  # -> Points, Tangents, Parameters
num_4 = Number(probability_text_height_2)
shatter = Shatter(Curve=rotate.Geometry, Parameters=divide.Parameters)
shatter_2 = Shatter(Curve=rotate_2.Geometry, Parameters=divide_2.Parameters)
multiplication_2 = Multiplication(A=num_4, B="1.5")
crv = Curve(flatten(shatter))
crv_2 = Curve(flatten(shatter_2))
num_5 = Number([num, directions_offset_2, multiplication_2])
offset = OffsetCurve(Curve=crv, Distance=remap.Mapped, Corners=1)  # -> flatten(Curve)
offset_2 = OffsetCurve(Curve=crv_2, Distance=multiplication_2, Corners=1)  # -> flatten(Curve)
ma = MassAddition(Input=num_5)  # -> Result, PartialResults
end = EndPoints(Curve=crv)  # -> Start, End
end_2 = EndPoints(Curve=crv_2)  # -> Start, End
crv_3 = Curve(flatten(offset))
curvepoint = PointOnCurve(offset_2, parameter=0.5)
probability_percent = Number(python_5.p_list)
probability_direction = Number(python_5.d_list)
addition_2 = Addition(A=ma.Result, B=directions_offset_2)
merge_3 = Merge(Data1=graft(crv_3), Data2=graft(crv))
num_6 = Number(probability_text_height_2)
pt_3 = Point(curvepoint)
num_7 = Number(addition_2)
num_8 = Number(addition)
num_9 = Number(multiplication)
num_10 = Number(directions_text_height_2)
num_11 = Number(probability_text_height_2)
python_6 = GhPythonScript(points_in=pt_3, h=num_6)  # -> out, flatten(points_out)
# ---------- python_6: Python ----------
__author__ = "philipp zimmermann"
__version__ = "2024.02.14"

import rhinoscriptsyntax as rs

points_out=[]
for i in [points_in]:
    point = rs.coerce3dpoint(i)
    points_out.append(rs.CreatePoint(point.X-h, point.Y-h/2))
# ---------- end python_6 ----------
loft = Loft(Curves=merge_3, Options={Adjust=False, Closed=False, LoftEnds=0, LoftSimp=0, LoftType=0, Rebuild=10, Refit=0.01})  # -> flatten(Loft)
ln = Line(StartPoint=end.End, EndPoint=end_2.End)
python_7 = GhPythonScript(r=num_7, x=num_8, y=num_9, o=num_11, h=num_10)  # -> out, points, directions
# ---------- python_7: Python ----------
__author__ = "philipp zimmermann"
__version__ = "2024.02.14"

import rhinoscriptsyntax as rs

points = []
points.append(rs.CreatePoint(x-h/2, y+r-h/2+o))
points.append(rs.CreatePoint(x+r-h/2+o, y-h/2))
points.append(rs.CreatePoint(x-h/2, y-r-h/2-o))
points.append(rs.CreatePoint(x-r-h-o, y-h/2))

directions = ['N','E','S','W']
# ---------- end python_7 ----------
probability_percent_2 = Number(probability_percent)
probability_direction_2 = Number(probability_direction)
txt_2 = Text(txt)
col = Colour(probability_text_color_2)
col_2 = Colour(windrose_color_2)
pt_4 = Point(python_6.points_out)
txt_3 = Text(python_7.directions)
geo = Geometry([ln, cir, loft])
col_3 = Colour(directions_text_color_2)
pt_5 = Point(python_7.points)
num_12 = Number(num_10)
preview = CustomPreview(Geometry=geo, Material=col_2)
tag = TextTag3D(Location=pt_4, Text=txt_2, Size=num_6, Colour=col, Justification=7)
tag_2 = TextTag3D(Location=pt_5, Text=txt_3, Size=num_12, Colour=col_3, Justification=7)
