# Grasshopper definition forma-api.gh (Grasshopper 1.0.7)
# Copyright: 2024
# plug-ins: Formicae, Swiftlet

panel = Panel("https://developer.api.autodesk.com/forma/wind-prediction/v1alpha/parameters")
auth = Auth(Trigger=Button())
clean = CleanTree(RemoveNulls=True, RemoveInvalid=True, RemoveEmpty=False, Tree=auth)
data = Data(flatten(clean))
ch = CreateHttpHeader(Key="x-ads-region", Value="EMEA")
bearer = BearerTokenAuth(Token=data)
cqp = CreateQueryParam(Key="authcontext", Value="pro_74nzjy4r4h")
merge = Merge(Data1=bearer, Data2=ch)
get = GETRequest(URL=panel, Params=cqp, Headers=merge)  # -> Status, Content, Response
panel_2 = Panel(merge)
panel_3 = Panel(get.Content)
post = POSTRequest(Headers=merge)  # -> Status, Content, Response
pjs = ParseJSONString(Text=get.Content)
panel_4 = Panel("https://app.2050-materials.com/developer/api/get_products")
# https://app.2050-materials.com/developer/api/get_products_count
panel_5 = Panel("https://app.2050-materials.com/developer/api/get_products")
gjok = GetJSONObjectKey(JObject=pjs, Key="api_token")
gjok_2 = GetJSONObjectKey(JObject=pjs, Key="refresh_token")
rjv = ReadJSONValue(JValue=gjok)  # -> AsString, AsNumber, AsBool
rjv_2 = ReadJSONValue(JValue=gjok_2)  # -> AsString, AsNumber, AsBool
python = GhPythonScript(api_token=rjv.AsString)  # -> out, a
# ---------- python: Python ----------
__author__ = "ARZE"
__version__ = "2023.11.02"

import rhinoscriptsyntax as rs

a = "Bearer" + " " + api_token
# ---------- end python ----------
ch_2 = CreateHttpHeader(Key="Authorization", Value=python.a)
ch_3 = CreateHttpHeader(Key="Authorization", Value=python.a)
cqp_2 = CreateQueryParam(Key="sort_by", Value="recycled_content")
cqp_3 = CreateQueryParam(Key="group_by", Value="company_name")
cqp_4 = CreateQueryParam(Key="Material Type Family", Value="5")
cqp_5 = CreateQueryParam(Key="certificate_type", Value="2")
c_script = CSharpScript(url=panel_4, token=rjv.AsString)  # -> out; inputs url: String, token: String
# ---------- c_script: C# usings ----------
using System.IO;
using System.Linq;
using System.Data;
using System.Drawing;
using System.Reflection;
using System.Windows.Forms;
using System.Xml;
using System.Xml.Linq;
using System.Runtime.InteropServices;

using Rhino.DocObjects;
using Rhino.Collections;
using GH_IO;
using GH_IO.Serialization;
# ---------- c_script: C# ----------
    var request = System.Net.WebRequest.Create(url);
    request.Timeout = 1000;
    request.Method = "GET";
    request.Headers["Authorization"] = "Bearer " + token;
    try
    {
      using (var response = request.GetResponse())
      {
        using (var stream = response.GetResponseStream())
        {
          var reader = new StreamReader(stream, System.Text.Encoding.UTF8);
          Print(reader.ReadToEnd());
        }
      }
    }
    catch (System.Net.WebException e)
    {
      Print(e.Message);
    }
# ---------- end c_script ----------
merge_2 = Merge(Data1=cqp_4, Data2=cqp_5, Data3=cqp_2)
get_2 = GETRequest(URL=panel_5, Params=merge_2, Headers=ch_2, UseTasks=True)  # -> Status, Content, Response
get_3 = GETRequest(URL=panel_4, Headers=ch_3, UseTasks=True)  # -> Status, Content, Response
pjs_2 = ParseJSONString(Text=get_2.Content)
rjv_3 = ReadJSONValue(JValue=pjs_2)  # -> AsString, AsNumber, AsBool
panel_6 = Panel(rjv_3.AsString)
